# Grasshopper definition FHinoporos_CSALT_WFECB.gh (Grasshopper 1.0.8)
# plug-ins: eleFront

# ----
# Doubleclick Me!
# INPUT PARAMETERS
panel = Panel("INPUT CURVES")
reference_by_layer = ReferenceByLayer(LayerName=panel, lightweight=False)
number_of_base_plates = Slider(1, range=1..5)
number_of_top_plates = Slider(2, range=1..5)
wall_height = Slider(2400, range=0..4000)
stud_component_size = ValueList({"2x4": 90, "2x6": 150, "2x8": 184}, selected="2x4")
on_center = ValueList({"12": 305, "14": 356, "16": 406, "18": 457, "20": 508, "22": 559, "24": 610}, selected="24")

input_curve = Curve(<curve referenced from the Rhino model>)
curves = CURVES(curve=reference_by_layer)

# ----
# PARAMETER DERIVATIVES
input_curve_vector = INPUTCURVEVECTOR(curve=curves)
input_curve_length = Length(Curve=curves)
perpendicular_vector = PERPENDICULARVECTOR(vector=input_curve_vector)

# ----
# TOP PLATE(S)
calcs = CALCS(A_2=wall_height, A=number_of_top_plates)
curve = Curve(curves)
unit_z = UnitZ(Factor=calcs)
move = Move(Geometry=curve, Motion=unit_z)  # -> Geometry, Transform
unit_z_2 = UnitZ(Factor=38)
extrude = Extrude(Base=move.Geometry, Direction=unit_z_2)
amplitude = Amplitude(Vector=perpendicular_vector, Amplitude=stud_component_size)
extrude_2 = Extrude(Base=extrude, Direction=amplitude)
linear_array = LinearArray(Geometry=extrude_2, Direction=unit_z_2, Count=number_of_top_plates)  # -> Geometry, Transform
custom_preview = CustomPreview(Geometry=linear_array.Geometry, Material=ColourSwatch(SwatchColor=RGB(195, 171, 139)))

# ----
# TOP PLATE(S)
volume_calculations = VOLUMECALCULATIONS(geometry=linear_array.Geometry)  # -> result_2, result
volume_in_ft3 = Panel(volume_calculations.result)
volume_in_m3 = Panel(volume_calculations.result_2)

# ----
# BASE PLATE (S)
unit_z_3 = UnitZ(Factor=38)
curve_2 = Curve(curves)
extrude_3 = Extrude(Base=curve_2, Direction=unit_z_3)
amplitude_2 = Amplitude(Vector=perpendicular_vector, Amplitude=stud_component_size)
extrude_4 = Extrude(Base=extrude_3, Direction=amplitude_2)
linear_array_2 = LinearArray(Geometry=extrude_4, Direction=unit_z_3, Count=number_of_base_plates)  # -> Geometry, Transform
custom_preview_2 = CustomPreview(Geometry=linear_array_2.Geometry, Material=ColourSwatch(SwatchColor=RGB(195, 171, 139)))

# ----
# BASE PLATE(S)
volume_calculations_2 = VOLUMECALCULATIONS(geometry=linear_array_2.Geometry)  # -> result_2, result
volume_in_m3_2 = Panel(volume_calculations_2.result_2)
volume_in_ft3_2 = Panel(volume_calculations_2.result)

# ----
# BLOCKING
division = Division(A=wall_height, B=2)
curve_3 = Curve(curves)
unit_z_4 = UnitZ(Factor=division)
unit_z_5 = UnitZ(Factor=38)
move_2 = Move(Geometry=curve_3, Motion=unit_z_4)  # -> Geometry, Transform
extrude_5 = Extrude(Base=move_2.Geometry, Direction=unit_z_5)
amplitude_3 = Amplitude(Vector=perpendicular_vector, Amplitude=stud_component_size)
extrude_6 = Extrude(Base=extrude_5, Direction=amplitude_3)

# ----
# STUDS
multiplication = Multiplication(A=number_of_base_plates, B=38)
curve_4 = Curve(curves)
unit_z_6 = UnitZ(Factor=multiplication)
move_3 = Move(Geometry=curve_4, Motion=unit_z_6)  # -> Geometry, Transform
height_calculations = HEIGHTCALCULATIONS(A=number_of_base_plates, A_3=wall_height, A_2=number_of_top_plates)
unit_z_7 = UnitZ(Factor=height_calculations)
perpendicular_lines = PERPENDICULARLINES(curve=move_3.Geometry, vector=perpendicular_vector, amplitude=stud_component_size)  # -> line_3, line_4
extrude_7 = Extrude(Base=perpendicular_lines.line_3, Direction=unit_z_7)
extrude_8 = Extrude(Base=perpendicular_lines.line_4, Direction=unit_z_7)
amplitude_4 = Amplitude(Vector=input_curve_vector, Amplitude=38)
amplitude_5 = Amplitude(Vector=input_curve_vector, Amplitude=-38)
extrude_9 = Extrude(Base=extrude_7, Direction=amplitude_4)
extrude_10 = Extrude(Base=extrude_8, Direction=amplitude_5)
o_c_calcs = OCCALCS(A=input_curve_vector, B=on_center, A_2=input_curve_length, B_2=on_center)  # -> result, result_2
cluster = Cluster(geometry=extrude_9, direction=o_c_calcs.result, count=o_c_calcs.result_2)

brep = Brep([cluster, extrude_10])

# ----
# STUDS
volume_calculations_3 = VOLUMECALCULATIONS(geometry=brep)  # -> result_2, result
volume_in_ft3_3 = Panel(volume_calculations_3.result)
volume_in_m3_3 = Panel(volume_calculations_3.result_2)

solid_difference = SolidDifference(BrepsA=extrude_6, BrepsB=flatten(brep))
custom_preview_3 = CustomPreview(Geometry=solid_difference, Material=ColourSwatch(SwatchColor=RGB(209, 128, 97)))

# ----
# BLOCKING
volume_calculations_4 = VOLUMECALCULATIONS(geometry=solid_difference)  # -> result_2, result
volume_in_ft3_4 = Panel(volume_calculations_4.result)
volume_in_m3_4 = Panel(volume_calculations_4.result_2)

# ----
# VOLUME OUTPUTS
addition = Addition(A=volume_in_m3_2, B=volume_in_m3, C=volume_in_m3_3, D=volume_in_m3_4)
addition_2 = Addition(A=volume_in_ft3_2, B=volume_in_ft3, C=volume_in_ft3_3, D=volume_in_ft3_4)
volume_in_m3_5 = Panel(addition)
volume_in_ft3_5 = Panel(addition_2)

# ----
# INSULATION
multiplication_2 = Multiplication(A=number_of_base_plates, B=38)
ins_height_calc = INSHEIGHTCALC(A=number_of_base_plates, A_2=wall_height, B=number_of_top_plates)
curve_5 = Curve(curves)
unit_z_8 = UnitZ(Factor=multiplication_2)
unit_z_9 = UnitZ(Factor=ins_height_calc)
move_4 = Move(Geometry=curve_5, Motion=unit_z_8)  # -> Geometry, Transform
extrude_11 = Extrude(Base=move_4.Geometry, Direction=unit_z_9)
amplitude_6 = Amplitude(Vector=perpendicular_vector, Amplitude=stud_component_size)
extrude_12 = Extrude(Base=extrude_11, Direction=amplitude_6)
studs_and_blocking = Brep(flatten([solid_difference, brep]))
solid_difference_2 = SolidDifference(BrepsA=extrude_12, BrepsB=studs_and_blocking)
# Doubleclick Me!
custom_preview_4 = CustomPreview(Geometry=solid_difference_2, Material=ColourSwatch(SwatchColor=RGBA(255, 131, 106, 98)))

# ----
# INSULATION
volume_calculations_5 = VOLUMECALCULATIONS(geometry=solid_difference_2)  # -> result_2, result
volume_in_m3_6 = Panel(volume_calculations_5.result_2)
volume_in_ft3_6 = Panel(volume_calculations_5.result)

custom_preview_5 = CustomPreview(Geometry=brep, Material=ColourSwatch(SwatchColor=RGB(192, 120, 20)))

# ==== cluster CALCS
A = ClusterInput()
multiplication = Multiplication(A=A, B=38)
A_2 = ClusterInput()
subtraction = Subtraction(A=A_2, B=multiplication)
result = ClusterOutput(subtraction)

# ==== cluster INPUTCURVEVECTOR
curve = ClusterInput()
end_points = EndPoints(Curve=curve)  # -> Start, End
vector_2pt = Vector2Pt(PointA=end_points.Start, PointB=end_points.End, Unitize=True)  # -> Vector, Length
vector = ClusterOutput(vector_2pt.Vector)

# ==== cluster INSHEIGHTCALC
A = ClusterInput()
B = ClusterInput()
addition = Addition(A=A, B=B)
multiplication = Multiplication(A=addition, B=38)
A_2 = ClusterInput()
subtraction = Subtraction(A=A_2, B=multiplication)
result = ClusterOutput(subtraction)

# ==== cluster PERPENDICULARVECTOR
unit_z = UnitZ(Factor=1)
vector = ClusterInput()
rotate = Rotate(Vector=vector, Axis=unit_z, Angle=degrees(Slider(270, range=0..1000)))
vector_2 = ClusterOutput(rotate)

# ==== cluster VOLUMECALCULATIONS
geometry = ClusterInput()
volume = Volume(Geometry=geometry)  # -> Volume, Centroid
division = Division(A=volume.Volume, B=Slider(100000000, range=0..100000000))
multiplication = Multiplication(A=division, B=Slider(35.31, range=0..100))
mass_addition = MassAddition(Input=multiplication)  # -> Result, PartialResults
mass_addition_2 = MassAddition(Input=division)  # -> Result, PartialResults
result = ClusterOutput(mass_addition.Result)
result_2 = ClusterOutput(mass_addition_2.Result)

# ==== cluster HEIGHTCALCULATIONS
A = ClusterInput()
A_2 = ClusterInput()
multiplication = Multiplication(A=A, B=38)
multiplication_2 = Multiplication(A=A_2, B=38)
addition = Addition(A=multiplication, B=multiplication_2)
A_3 = ClusterInput()
subtraction = Subtraction(A=A_3, B=addition)
result = ClusterOutput(subtraction)

# ==== cluster Cluster
geometry = ClusterInput()
direction = ClusterInput()
count = ClusterInput()
linear_array = LinearArray(Geometry=geometry, Direction=direction, Count=count)  # -> Geometry, Transform
geometry_2 = ClusterOutput(linear_array.Geometry)

# ==== cluster OCCALCS
A = ClusterInput()
B = ClusterInput()
A_2 = ClusterInput()
B_2 = ClusterInput()
multiplication = Multiplication(A=A, B=B)
division = Division(A=A_2, B=B_2)
result = ClusterOutput(multiplication)
result_2 = ClusterOutput(division)

# ==== cluster PERPENDICULARLINES
vector = ClusterInput()
amplitude = ClusterInput()
curve = ClusterInput()
amplitude_2 = Amplitude(Vector=vector, Amplitude=amplitude)
end_points = EndPoints(Curve=curve)  # -> Start, End
move = Move(Geometry=end_points.Start, Motion=amplitude_2)  # -> Geometry, Transform
move_2 = Move(Geometry=end_points.End, Motion=amplitude_2)  # -> Geometry, Transform
line = Line(StartPoint=end_points.Start, EndPoint=move.Geometry)
line_2 = Line(StartPoint=end_points.End, EndPoint=move_2.Geometry)
line_3 = ClusterOutput(line)
line_4 = ClusterOutput(line_2)

# ==== cluster CURVES
curve = ClusterInput()
explode = Explode(Curve=curve, Recursive=True)  # -> Segments, Vertices
input_curves = Curve(explode.Segments)
input_curves_2 = ClusterOutput(input_curves)
